# Grasshopper definition heart.gh (Grasshopper 0.9.80)
# plug-ins: Python Interpreter, Weaverbird

number_slider = Slider(7, range=2..10)
thickness = Slider(5, range=0..10)
seed = Slider(73.87, range=0..100)
box = Box({Plane=PlaneXY(-50, -50, 0), X=Domain(0, 100), Y=Domain(0, 100), Z=Domain(0, 100)})
python_hash = PythonScript(x=seed)  # -> out, a
# ---------- python_hash: Python ----------
secret = 66238732490534009356485427134777367
a = hash((x,secret))
# ---------- end python_hash ----------
python_date_hr = PythonScript(x=seed)  # -> out, a
# ---------- python_date_hr: Python ----------
# returns time in min

import time
seconds = time.time()
minutes = seconds / 60
a = round(minutes)
# ---------- end python_date_hr ----------
join = TextJoin(Text=[python_date_hr.a, number_slider, seed, thickness])
pop3d = Populate3D(Region=box, Count=number_slider, Seed=python_hash.a)
area = Area(Geometry=box)  # -> Area, Centroid
panel = Panel(join)
vcell = VoronoiCell(Point=area.Centroid, Neighbours=pop3d)
debrep = DeconstructBrep(Brep=vcell)  # -> Faces, Edges, Vertices
crv = Curve(debrep.Faces)
wbframe = WeaverbirdsPictureFrame(MeshPolylines=crv, Distance=5, InsetType=0)
wboffset = WeaverbirdsOffsetMesh(MeshCurves=wbframe, Distance=thickness, OffsetType=0)
wbcatmullclark = WeaverbirdsCatmullClarkSubdivision(MeshCurves=wboffset, Level=3, SmoothNakedEdges=1)
