# Grasshopper definition voronoi.gh (Grasshopper 0.9.80)

srf = Surface(<surface referenced from the Rhino model>)
box = Box({Plane=PlaneXY(-10, -10, 0), X=Domain(0, 20), Y=Domain(0, 20), Z=Domain(0, 20)})
popgeo = PopulateGeometry(Geometry=srf, Count=Slider(100, range=0..100), Seed=Slider(100, range=0..100))
pop3d = Populate3D(Region=box, Count=Slider(11, range=0..100), Seed=1)
voronoi = Voronoi(Points=popgeo, Boundary=srf, BruteForceOverride=False)
voronoi_2 = Voronoi(Points=pop3d, Boundary=box, BruteForceOverride=False)
vcell = VoronoiCell()
